# Grasshopper definition SyncSender_TaskCapable.gh (Grasshopper 1.0.7)
# Copyright: Arup
# plug-ins: Speckle (CX)

arup_uk_sp_stamatios = Accounts(email="stamatios.psarras@arup.com", restapi="https://uk.speckle.arup.com/api")
projects = Projects(Account=arup_uk_sp_stamatios)  # -> Projects, SelectedProject
item = ListItem(List=projects.Projects, Index=0, Wrap=True)
dss = DataSenderSync(Account=arup_uk_sp_stamatios, StreamId="This In not a stream ID", Project=item)
panel = Panel(dss)
